# Grasshopper definition Bounds 2D等价用法.gh (Grasshopper 1.0.7)

panel = Panel("Bound 2D 的等价形式")
random = Random(Range=Domain(0, 1), Number="100", Seed="5")
random_2 = Random(Range=Domain(0, 1), Number="100", Seed="6")
pt = ConstructPoint(XCoordinate=random, YCoordinate=random_2, ZCoordinate=0)
pdecon = Deconstruct(Point=pt)  # -> XComponent, YComponent, ZComponent
bnd = Bounds(Numbers=pdecon.XComponent)
bnd_2 = Bounds(Numbers=pdecon.YComponent)
dom² = ConstructDomain²(DomainU=bnd, DomainV=bnd_2)
bnd_3 = Bounds2D(Coordinates=pt)
panel_2 = Panel(dom²)
panel_3 = Panel(bnd_3)
