# Grasshopper definition Domain方向性.gh (Grasshopper 1.0.7)

panel = Panel("区间在使用时需注意端点顺序会影响后续结果")
pi = Pi(Factor=1)
pi_2 = Pi(Factor=1)
dom = ConstructDomain(DomainStart="0", DomainEnd=pi)
dom_2 = ConstructDomain(DomainStart=pi_2, DomainEnd="0")
panel_2 = Panel(dom)
panel_3 = Panel(dom_2)
range = Range(Domain=dom, Steps=Slider(10, range=0..10))
range_2 = Range(Domain=dom_2, Steps=Slider(10, range=0..10))
panel_4 = Panel(range)
panel_5 = Panel(range_2)
