# Grasshopper definition Domain取最值.gh (Grasshopper 1.0.7)

panel = Panel("常利用区间端点来获得数据列表的最值")
random = Random(Range=Domain(0, 1), Number="10", Seed=2)
bnd = Bounds(Numbers=random)
panel_2 = Panel(random)
dedomain = DeconstructDomain(Domain=bnd)  # -> Start, End
min = Panel(dedomain.Start)
max = Panel(dedomain.End)
