# Grasshopper definition 曲线区间等分着色.gh (Grasshopper 1.0.7)

panel = Panel("对曲线进行等分，并且随机着色显示")

# ---- group: Input
number_slider = Slider(13, range=0..100)
cir = Circle(Plane=PlaneXY(0, 0, 0), Radius=1)

# ----
crvdom = CurveDomain(Curve=cir)  # -> Curve, Domain
div = DivideDomain(Domain=crvdom.Domain, Count=number_slider)
lng = ListLength(List=div)
subcrv = SubCurve(BaseCurve=cir, Domain=div)
random = Random(Range=Domain(0, 1), Number=lng, Seed=2)
hsl = ColourHSL(Alpha=1, Hue=random, Saturation=1, Luminance=0.5)

# ---- group: output
preview = CustomPreview(Geometry=subcrv, Material=hsl)
