# Grasshopper definition Divide Domain2常用用法.gh (Grasshopper 1.0.7)

panel = Panel("细分曲面的常用用法")
domain = Domain("100")
rectangle = Rectangle(Plane=PlaneXY(0, 0, 0), XSize=domain, YSize=domain, Radius=0)  # -> Rectangle, Length
number_slider = Slider(6, range=0..10)
boundary = BoundarySurfaces(Edges=rectangle.Rectangle, UseTasks=False)
domain² = Domain²(boundary)
divide = DivideDomain²(Domain=domain², UCount=number_slider, VCount=number_slider)
subsrf = Isotrim(Surface=boundary, Domain=divide)
