# Grasshopper definition Includes闭区间.gh (Grasshopper 1.0.7)

panel = Panel("此运算器判断区间为闭区间")
panel_2 = Panel("""-1
0
1
Pi
2*Pi""")
inc = Includes(Value=panel_2, Domain="0 to Pi")  # -> Includes, Deviation
panel_3 = Panel(inc.Includes)
panel_4 = Panel(inc.Deviation)
