# Grasshopper definition Remap区间截断.gh (Grasshopper 1.0.7)

panel = Panel("曲线干扰中常用于限制干扰范围")
series = Series(Start=0, Step=Slider(0.1, range=0..0.1), Count=Slider(100, range=0..100))
sin = Sine(Value=series)
remap = RemapNumbers(Value=sin, Source="-0.5 to 0.5", Target="-1 to 1")  # -> Mapped, Clipped
pt = ConstructPoint(XCoordinate=series, YCoordinate=remap.Clipped, ZCoordinate=0)
