# Grasshopper definition Construct Matrix.gh (Grasshopper 1.0.7)

panel = Panel("""0
1
2
3
4
5
6
7
8
9
10
11
12
13
14""")
# Construct Matrix  创建数值矩阵
列 = Slider(3, range=0..100)
行 = Slider(5, range=0..100)
matrix = ConstructMatrix(Rows=列, Columns=行, Values=panel)
panel_2 = Panel(matrix)
matrix_2 = DisplayMatrix(matrix)
