# Grasshopper definition Invert Matrix.gh (Grasshopper 1.0.7)

matrix = Matrix({0;0=1, 0;1=2, 1;0=-1, 1;1=-3, columns=2, rows=2})
# 逆矩阵详见百度百科
# 设A是一个n阶矩阵，若存在另一个n阶矩阵B，使得： AB=BA=E ，
# 则称方阵A可逆，并称方阵B是A的逆矩阵
invert_matrix = InvertMatrix(Matrix=matrix, Tolerance=0)  # -> Matrix, Success
display_matrix = DisplayMatrix(invert_matrix.Matrix)
# Invert Matrix 计算逆矩阵
display_matrix_2 = DisplayMatrix(matrix)
