# Grasshopper definition Swap Columns.gh (Grasshopper 1.0.7)

要交换的列 = Slider(2, range=0..100)
要交换的列_2 = Slider(3, range=0..100)
matrix = Matrix({0;0=0, 0;1=1, 0;2=2, 0;3=3, 0;4=4, 1;0=5, 1;1=6, 1;2=7, 1;3=8, 1;4=9, 2;0=10, 2;1=11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})
# Swap Columns  矩阵 列位置交换
# 0
# 2
# 1
# 3
display_matrix = DisplayMatrix(matrix)
swap_columns = SwapColumns(Matrix=matrix, ColumnA=要交换的列, ColumnB=要交换的列_2)
panel = Panel(matrix)
# 2
# 0
# 1
# 3
display_matrix_2 = DisplayMatrix(swap_columns)
