# Grasshopper definition Transpose Matrix.gh (Grasshopper 1.0.7)

matrix = Matrix({0;0=0, 0;1=1, 0;2=2, 0;3=3, 0;4=4, 1;0=5, 1;1=6, 1;2=7, 1;3=8, 1;4=9, 2;0=10, 2;1=11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})
# Transpose Matrix 交换行与列
display_matrix = DisplayMatrix(matrix)
transpose_matrix = TransposeMatrix(Matrix=matrix)
display_matrix_2 = DisplayMatrix(transpose_matrix)
