# Grasshopper definition Combine Date & Time.gh (Grasshopper 1.0.7)

# Combine Date & Time  合并日期&时间
time = Time(638002656000000001)
time_2 = Time(366100000002)
panel = Panel(time)
panel_2 = Panel(time_2)
cdate = CombineDateTime(Date=time, Time=time_2)
panel_3 = Panel(cdate)
