# Grasshopper definition Construct Date.gh (Grasshopper 1.0.7)

# Construct Exotic Date  建立日期数据
# 自动计算周几，准确到天
年 = Panel("2022")
月 = Panel("10")
日 = Panel("2")
dateex = ConstructExoticDate(Year=年, Month=月, Day=日, Calendar=0)
panel = Panel(dateex)
