# Grasshopper definition Construct Exotic Date.gh (Grasshopper 1.0.7)

# Construct Date 建立时间数据，准确到秒
年 = Panel("2022")
月 = Panel("10")
日 = Panel("2")
时 = Panel("10")
分 = Panel("10")
秒 = Panel("10")
date = ConstructDate(Year=年, Month=月, Day=日, Hour=时, Minute=分, Second=秒)
panel = Panel(date)
