# Grasshopper definition Construct Smooth Time.gh (Grasshopper 1.0.7)

日 = Panel("2")
时 = Panel("10")
分 = Panel("10")
秒 = Panel("10")
# Construct Smooth Time
# 建立时间段，准确到秒
smtime = ConstructSmoothTime(Days=日, Hours=时, Minutes=分, Seconds=秒)
panel = Panel(smtime)
