# Grasshopper definition Construct Time.gh (Grasshopper 1.0.7)

# Construct Time 建立时间
# 准确到秒顺序为时：分：秒
时 = Panel("10")
分 = Panel("10")
秒 = Panel("10")
time = ConstructTime(Hour=时, Minute=分, Second=秒)
panel = Panel(time)
