# Grasshopper definition Date Range.gh (Grasshopper 1.0.7)

# Date Range 等分时间段
time = Time(638003022100000000)
time_2 = Time(638029806100000000)
panel = Panel(time_2)
panel_2 = Panel(time)
date_range = DateRange(TimeA=time, TimeB=time_2, Count=Slider(10, range=0..100))
panel_3 = Panel(date_range)
