# Grasshopper definition Deconstruct Date.gh (Grasshopper 1.0.7)

time = Time(638003022100000000)
# Deconstruct Date  拆分年 日期时间
panel = Panel(time)
ddate = DeconstructDate(Date=time)  # -> Year, Month, Day, Hour, Minute, Second
年 = Panel(ddate.Year)
月 = Panel(ddate.Month)
日 = Panel(ddate.Day)
时 = Panel(ddate.Hour)
分 = Panel(ddate.Minute)
秒 = Panel(ddate.Second)
