# Grasshopper definition Interpolate Date.gh (Grasshopper 1.0.7)

比例 = Slider(12, range=6..50)
time = Time(638003022100000000)
time_2 = Time(638029806100000000)
# Interpolate Date  按比例取该段时间内的某个时刻
panel = Panel(time)
panel_2 = Panel(time_2)
intdate = InterpolateDate(DateA=time, DateB=time_2, Interpolation=比例)
panel_3 = Panel(intdate)
