# Grasshopper definition MultiPipe短线段剔除.gh (Grasshopper 1.0.7)
# plug-ins: Kangaroo2 Components

R = Region({Plane=PlaneXY(0, 0, 0), X=Domain(0, 10), Y=Domain(0, 10), Z=Domain(0, 2)})
panel = Panel("解决MultiPipe在遇到短线是产生错误突角的Bug的一种方式")
pop3d = Populate3D(Region=R, Count="50", Seed=1)
voronoi³ = Voronoi3D(Points=pop3d, Box=R)  # -> Cells, Boundary
edges = BrepEdges(Brep=voronoi³.Cells)  # -> Naked, flatten(Interior), NonManifold
line = Line(edges.Interior)
dupln = RemoveDuplicateLines(Lines=line, Tolerance=0.01)

# ---- group: 短线段剔除
panel_2 = Panel("保证此输入端数值大于NodeSide")
end = EndPoints(Curve=dupln)  # -> Start, End
merge = Merge(Data1=end.Start, Data2=end.End)  # -> flatten(Result)
cullpt = CullDuplicates(Points=merge, Tolerance=Slider(0.2, range=0..1), CullMode=3)  # -> Points, Indices, Valence
cp = ClosestPoint(Point=graft(end.Start), Cloud=cullpt.Points)  # -> flatten(ClosestPoint), CPIndex, Distance
cp_2 = ClosestPoint(Point=graft(end.End), Cloud=cullpt.Points)  # -> flatten(ClosestPoint), CPIndex, Distance
equals = Equality(FirstNumber=cp.ClosestPoint, SecondNumber=cp_2.ClosestPoint)  # -> Equality, Inequality
cull = CullPattern(List=cp.ClosestPoint, CullPattern=equals.Inequality)
cull_2 = CullPattern(List=cp_2.ClosestPoint, CullPattern=equals.Inequality)
ln = Line(StartPoint=cull, EndPoint=cull_2)

# ----
len = Length(Curve=dupln)
bnd = Bounds(Numbers=len)
dedomain = DeconstructDomain(Domain=bnd)  # -> Start, End
panel_3 = Panel(dedomain.Start)
number_slider = Slider(0.1, range=0..0.1)
len_2 = Length(Curve=ln)
mp = MultiPipe(Curves=dupln, NodeSize=number_slider, EndOffset=1, StrutSize=1, Segment=0, KinkAngle=0.6, CubeFit=0, Caps=0)
mp_2 = MultiPipe(Curves=ln, NodeSize=number_slider, EndOffset=1, StrutSize=1, Segment=0, KinkAngle=0.6, CubeFit=0, Caps=0)
bnd_2 = Bounds(Numbers=len_2)
dedomain_2 = DeconstructDomain(Domain=bnd_2)  # -> Start, End
panel_4 = Panel(dedomain_2.Start)
