# Grasshopper definition Char Sequence.gh (Grasshopper 1.0.7)

# Char Sequence 根据字符和行数进行排列组合，不晓得干吗用
# EMMM可能创建字典用来暴力破解？咳咳咳
number_slider = Slider(100, range=0..100)
charseq = CharSequence(Count=number_slider, CharPool="ACFGVXZ", Format="{0}")
panel = Panel(charseq)
