# Grasshopper definition Cull Index.gh (Grasshopper 1.0.7)

是否循环查找 = BooleanToggle(False)
panel = Panel("""6
12
18
24
30
36
42
48
54
60""")
# Cull Index 剔除序号对应的数据
cull_index = CullIndex(List=panel, Indices=Slider(0, range=0..100), Wrap=是否循环查找)
panel_2 = Panel(cull_index)
