# Grasshopper definition Cull Nth.gh (Grasshopper 1.0.7)

panel = Panel("""6
12
18
24
30
36
42
48
54
60""")
culln = CullNth(List=panel, CullFrequency=Slider(2, range=0..100))
# Cull Nth 剔除第N的整数倍的数据
panel_2 = Panel(culln)
