# Grasshopper definition Cull Pattern.gh (Grasshopper 1.0.7)

panel = Panel("""6
12
18
24
30
36
42
48
54
60""")
panel_2 = Panel("""true
false""")
# Cull Pattern 值为真保留数据
# 假剔除数据自动循环
cull = CullPattern(List=panel, CullPattern=panel_2)
panel_3 = Panel(cull)
