# Grasshopper definition Duplicate Data.gh (Grasshopper 1.0.7)

重复次数 = Slider(2, range=0..100)
改变重复形式 = BooleanToggle(True)
# Duplicate Data 重复整个列表的数据
panel = Panel("""1
2
3""")
# 两只可爱的小兔兔，
# 兔兔这么可爱，
# 怎么忍心让兔兔工作
dup = DuplicateData(Data=panel, Number=重复次数, Order=改变重复形式)
panel_2 = Panel(dup)
