# Grasshopper definition Fibonacci.gh (Grasshopper 1.0.7)

第二个数 = Slider(10, range=6..50)
生成数量 = Slider(8, range=0..100)
# Fibonacci  斐波那契数列
第一个数 = Slider(0, range=0..50)
# 兔子数列图标不是兔子，差评
fib = Fibonacci(SeedA=第一个数, SeedB=第二个数, Number=生成数量)
panel = Panel(fib)
