# Grasshopper definition Jitter.gh (Grasshopper 1.0.7)

随机因子 = Slider(5, range=0..100)
打乱程度 = Slider(1, range=0..1)
panel = Panel("""1
2
3
4
5
6""")
# Jitter 随机打乱数据顺序
jitter = Jitter(List=panel, Jitter=打乱程度, Seed=随机因子)  # -> Values, Indices
打乱后对应的原始序号 = Panel(jitter.Indices)
panel_2 = Panel(jitter.Values)
