# Grasshopper definition Random Reduce.gh (Grasshopper 1.0.7)

panel = Panel("""6
12
18
24
30
36
42
48
54
60""")
# Random Reduce  随机删除数据
删除数量 = Slider(5, range=0..100)
随即因子 = Slider(5, range=0..100)
reduce = RandomReduce(List=panel, Reduction=删除数量, Seed=随即因子)
panel_2 = Panel(reduce)
