# Grasshopper definition Random.gh (Grasshopper 1.0.7)

# Random 在一个范围内取一个 随机数值
# 此项正确应为范围值，直接赋予数值为从0开始
范围 = Slider(10, range=0..100)
数量 = Slider(3, range=0..100)
随机因子 = Slider(7, range=0..100)
random = Random(Range=范围, Number=数量, Seed=随机因子, Integers=False)
num = Number(random)
# 可以约束他生成的值为浮点数或者是整数
int = Integer(random)
panel = Panel(num)
panel_2 = Panel(int)
