# Grasshopper definition Range.gh (Grasshopper 1.0.7)

# Range  创建等差数列
# 正常这个位置接的是一个范围，比如0 to 10的样子，直接赋予数值也可以，默认0开始到数字
number_slider = Slider(5, range=0..100)
range = Range(Domain=number_slider, Steps=Slider(10, range=0..100))
panel = Panel(range)
