# Grasshopper definition Repeat Data.gh (Grasshopper 1.0.7)

# Repeat Data 重复数据到指定长度
number_slider = Slider(8, range=0..100)
panel = Panel("""1
2""")
repeat = RepeatData(Data=panel, Length=number_slider)
panel_2 = Panel(repeat)
