# Grasshopper definition Sequence.gh (Grasshopper 1.0.7)

# Sequence 根据指定规则，生成一组指定长度的数列，
# 默认为[N-1]+[N-2]，也就是下一个数等于前两个数的和
number_slider = Slider(12, range=0..100)
# 自行理解吧
panel = Panel("[N-1]-[N-2]")
panel_2 = Panel("""1
2""")
seq = Sequence(Notation=panel, Length=number_slider, Initial=panel_2)
panel_3 = Panel(seq)
