# Grasshopper definition Series.gh (Grasshopper 1.0.7)

# Series 创建一个等差数列
开始数 = Slider(6, range=6..50)
间隔 = Slider(6, range=6..50)
总列表数 = Slider(10, range=0..100)
series = Series(Start=开始数, Step=间隔, Count=总列表数)
panel = Panel(series)
