# Grasshopper definition Stack Data.gh (Grasshopper 1.0.7)

panel = Panel("""1
2
2
1""")
# Stack Data 创建一个新的数据列表
# 指定每个数据的重复数量
panel_2 = Panel("""a
b
c
d""")
stack = StackData(Data=panel_2, Stack=panel)
panel_3 = Panel(stack)
