# Grasshopper definition 两列表相同序号数据分组.gh (Grasshopper 1.0.7)
# 可能用于将数据分类合并的场景

panel = Panel("""33
55
56
45""")
panel_2 = Panel("""g
r
a
s""")
carthesian_product = Panel("将AB两组数据相同序号的数据放到一组内，要求AB两组数据数量一致")
cprod = CarthesianProduct(SetA=panel, SetB=panel_2)
panel_3 = Panel(cprod)
