# Grasshopper definition 删除重复合并汇总数据.gh (Grasshopper 1.0.7)
# 你可能在汇总合并数据,汇总合并带有用户字典的物件编号时候用到

panel = Panel("""1
2
2
3
ddd
ddd
66
55
58
汉字
汉字""")
# Create Set: 合并数列中所有相同数据
# S端返回删除重复项之后的数据
# M端返回相同数据在S端中的序号
# L端除了数字，还可以是矢量，布尔值等
# 经常配合Member Index用来统计编号数量,
cset = CreateSet(List=panel)  # -> Set, Map
random = Random(Range="0 to 5", Number=Slider(10, range=0..10), Seed=2, Integers=True)
panel_2 = Panel(cset.Set)
panel_3 = Panel(cset.Map)
panel_4 = Panel(random)
cset_2 = CreateSet(List=panel_4)  # -> Set, Map
mindex = MemberIndex(Set=panel_4, Member=cset_2.Set)  # -> Index, Count
concat = Concatenate(FragmentA=cset_2.Set, FragmentB=",", FragmentC=mindex.Count)
item = ListItem(List=panel_4, Index=mindex.Index, Wrap=True)
panel_5 = Panel(concat)
panel_6 = Panel(item)
panel_7 = Panel(mindex.Index)
