# Grasshopper definition 删除临近重复数据.gh (Grasshopper 1.0.7)
# 可能用于对比删除规格化数据之后的重复数据

panel = Panel("""1
2
2
3
5
5
2
0
1""")
是否判断首尾两个数据是否重复 = BooleanToggle(True)
delete_consecutive = Panel("删除临近的重复的数据，并返回一共删除了多少个数据")
dcon = DeleteConsecutive(Set=panel, Wrap=是否判断首尾两个数据是否重复)  # -> Set, Count
panel_2 = Panel(dcon.Set)
panel_3 = Panel(dcon.Count)
