# Grasshopper definition 判断数据是否是有交集.gh (Grasshopper 1.0.7)
# 可能应用与对比处理数据场景

panel = Panel("""33
55
56
45""")
panel_2 = Panel("""g
r
a
s""")
# Disjoint: 判断AB两组数据是不是没有相同元素。如果没有相同数据，就返回True，有相同数据，就返回False
disjoint = Disjoint(SetA=panel, SetB=panel_2)
panel_3 = Panel(disjoint)
