# Grasshopper definition 数据规格化,合并规范铝板长度.gh (Grasshopper 1.0.7)
# 可以用来做数据规格化,比如整合数据保证最小位数保持.5或0

number_slider = Slider(8, range=0..10)
find_similar_member = Panel("""在Set端中查找于Data端数据最接近的数据并替换,
一定要注意数据类型哦
可以用来做数据规格化""")
random = Random(Range="0 to 5", Number=number_slider, Seed=2)
range = Range(Domain="0 to 5", Steps=number_slider)
panel = Panel(random)
panel_2 = Panel(range)
fsim = FindSimilarMember(Data=random, Set=range)  # -> Hit, Index
panel_3 = Panel(fsim.Hit)
