# Grasshopper definition 检索自定义字典,用来查找已知数据在数据流中序号.gh (Grasshopper 1.0.7)
# 自己做一个字典,再根据已知去提取数据
# 经常用来查找某个点在一堆点中的序号

panel = Panel("""rhino
gh
study
you
but""")
lng = ListLength(List=panel)
key_value_search = Panel("""首先Keys端和value端数据一一对应，通过serch端输入对应的key值调取对应的数据
简单讲自己做一个字典,再根据已知去提取数据""")
series = Series(Start=0, Step=1, Count=lng)
panel_2 = Panel("""rhino
gh""")
panel_3 = Panel(series)
keysearch = KeyValueSearch(Keys=panel, Values=series, Search=panel_2)
panel_4 = Panel(keysearch)
