# Grasshopper definition 合并汇总数据.gh (Grasshopper 1.0.7)
# 这个你很有可能用于统计物件编号数量
# 这样搭配就是Excel中的sumif的功能

random = Random(Range="0 to 5", Number=Slider(10, range=0..10), Seed=2, Integers=True)
panel = Panel(random)
# Member Index: 返回Member端数据在Set端数据里的出现的序号，以及数量，经常配合Create set用来统计编号数量,
# 注意数据类型的统一
cset = CreateSet(List=panel)  # -> Set, Map
mindex = MemberIndex(Set=panel, Member=cset.Set)  # -> Index, Count
concat = Concatenate(FragmentA=cset.Set, FragmentB=",", FragmentC=mindex.Count)
item = ListItem(List=panel, Index=mindex.Index, Wrap=True)
panel_2 = Panel(concat)
panel_3 = Panel(item)
panel_4 = Panel(mindex.Index)
