# Grasshopper definition 查找替换数据.gh (Grasshopper 1.0.7)
# 可能用于数据的替换操作

panel = Panel("""gh
rhino""")
panel_2 = Panel("""2
3
5
2
0""")
panel_3 = Panel("""2
0""")
replace = ReplaceMembers(Set=panel_2, Find=panel_3, Replace=panel)
replace_members = Panel("""查找Set端数据中指定的数据并替换。需要注意的是，你需要确保用来查找和匹配的数据都是一样类型的
还有查找的和替换的数量统一""")
panel_4 = Panel(replace)
