# Grasshopper definition 数据布尔,返回非交集部分.gh (Grasshopper 1.0.7)
# 这是个差集,
# 你可能在需要筛选字符串或筛选带有用户字典的物件的时候用到它

panel = Panel("""11
01
汉字
abc""")
panel_2 = Panel("""汉字
abc
05""")
set_difference_s = Panel("""返回AB两组数据中只在A或只在B列表中存在的数据
除了数字，还可以是矢量，布尔值等""")
exdiff = SetDifferenceS(SetA=panel, SetB=panel_2)
panel_3 = Panel(exdiff)
