# Grasshopper definition 数据布尔,返回A组中非交集部分.gh (Grasshopper 1.0.7)
# 这是个差集,
# 你可能在需要筛选字符串或筛选带有用户字典的物件的时候用到它

panel = Panel("""01
02
LB-01-001
这是文字""")
panel_2 = Panel("""02
这是文字
03""")
set_difference = Panel("""返回AB两组数列中A有而B没有的数据
除了数字，还可以是矢量，布尔值等""")
difference = SetDifference(SetA=panel, SetB=panel_2)
panel_3 = Panel(difference)
