# Grasshopper definition 数据布尔,返回交集部分.gh (Grasshopper 1.0.7)
# 可能会在筛选比较数据的时候用到

panel = Panel("""123
321
456
987
ddd
bbb
nnn
汉字""")
panel_2 = Panel("""123
321
ddd
nnn
汉字""")
set_intersection = Panel("""返回列表A和列表B中都有的数据
除了数字，还可以是矢量，布尔值等""")
intersection = SetIntersection(SetA=panel, SetB=panel_2)
panel_3 = Panel(intersection)
