# Grasshopper definition 筛选多次重复出现数据.gh (Grasshopper 1.0.7)
# 可能会用在用于比较重复数据的场景

panel = Panel("""5
25
44
44
95
54""")
panel_2 = Panel("""738
738
56
54
5""")
panel_3 = Panel("""t
gh
gh
kk
95""")
set_majority = Panel("""返回ABC三组数据中出现超过一次的数据
(在同A端中出现超过一次不计)""")
majority = SetMajority(SetA=panel, SetB=panel_2, SetC=panel_3)
panel_4 = Panel(majority)
