# Grasshopper definition 数据布尔,并集.gh (Grasshopper 1.0.7)
# 这个是数据并集,可能用于统计数据场景

panel = Panel("""12
23
54""")
panel_2 = Panel("""78
hh
]]""")
set_union = Panel("返回AB两组数据中出现过的所有的数据")
sunion = SetUnion(SetA=panel, SetB=panel_2)
panel_3 = Panel(sunion)
