# Grasshopper definition 判断数据是否是包含关系.gh (Grasshopper 1.0.7)
# 可能用于判断数据的包含关系的场景

panel = Panel("""12
2
0""")
panel_2 = Panel("""2
0""")
subset = Panel("判断B组数据是不是A组数据的子集")
subset_2 = SubSet(SetA=panel, SetB=panel_2)
panel_3 = Panel(subset_2)
