# Grasshopper definition Characters.gh (Grasshopper 1.0.7)
# Characters 拆分文字为单个字符，Unicode输出端为拆分并转换成Unicode码

# Characters 拆分文字为单个字符，
# Unicode输出端为拆分并转换成Unicode码
panel = Panel("我爱GRASHOPPER123，。")
characters = Characters(Text=panel)  # -> Result, Unicode
panel_2 = Panel(characters.Result)
panel_3 = Panel(characters.Unicode)
