# Grasshopper definition Format.gh (Grasshopper 1.0.7)
# Format格式化参数 使用Data0 Data1端替换format端{ }内的内容

# Format格式化参数 使用Data0 Data1端替换format端{ }内的内容
panel = Panel("""全员核酸检测通知
{0}进行全员核酸检测，
1.检测时间: {1}
2.检测地点:肯德基大门口
自觉排队，准备好微信扫一扫，v我{2:F2}后迅速离开。""")
format = Format(Format=panel, Culture=127, Data0="9月29日", Data1="14：00", Data2=Slider(50, range=0..100))
panel_2 = Panel(format)
