# Grasshopper definition Match Text.gh (Grasshopper 1.0.7)
# Match Text查看Pattern输入字符与列表中字符相符，输出布尔值。

条件2与条件1相同才会输出布尔值可不加 = Panel("A")
# Match Text查看Pattern输入字符与列表中字符相符，输出布尔值。
panel = Panel("""1
7
3
A
5
6
7
a""")
区分大小写 = BooleanToggle(False)
条件一 = Panel("a")
tmatch = MatchText(Text=panel, Pattern=条件一, RegEx=条件2与条件1相同才会输出布尔值可不加, Case=区分大小写)
panel_2 = Panel(tmatch)
