# Grasshopper definition Replace Text.gh (Grasshopper 1.0.7)
# Replace Text 查找替换

# Replace Text 查找替换
panel = Panel("""1
7
3
A
5
6
7
Aa""")
区分大小写 = Panel("A")
rep = ReplaceText(Text=panel, Find=区分大小写, Replace="box", RecursiveReplace=False)
panel_2 = Panel(rep)
