# Grasshopper definition Sort Text.gh (Grasshopper 1.0.7)
# Sort Text  排序文字。
# 可以通过Keys输入端文字的排序来重新排序Values端的数据，反之亦然。

panel = Panel("""0
2
1
3
4
6
5""")
# Sort Text  排序文字。
# 可以通过Keys输入端文字的排序来重新排序Values端的数据，反之亦然。
# 默认顺序数字然后字母
panel_2 = Panel("""1
7
3
A
5
6
7""")
tsort = SortText(Keys=panel_2, Values=panel, Culture=127)  # -> Keys, Values
panel_3 = Panel(tsort.Values)
panel_4 = Panel(tsort.Keys)
