# Grasshopper definition Text Case.gh (Grasshopper 1.0.7)
# Text Case 转换大小写 
# 统一转换成大写或者小写

# Text Case 转换大小写
# 统一转换成大写或者小写
panel = Panel("Text Case")
case = TextCase(Text=panel, Culture=127)  # -> UpperCase, LowerCase
panel_2 = Panel(case.UpperCase)
panel_3 = Panel(case.LowerCase)
