# Grasshopper definition Text Distance.gh (Grasshopper 1.0.7)
# Text Distance 计算两串字符的相似度 
# 也就是计算由B输入端编辑成A所需要的编辑最少次数

# Text Distance 计算两串字符的相似度
# 也就是计算由B输入端编辑成A所需要的编辑最少次数
panel = Panel("ABCD")
tdist = TextDistance(TextA=panel, TextB="BCDA", Case=True)
panel_2 = Panel(tdist)
