# Grasshopper definition Text Fragment.gh (Grasshopper 1.0.7)
# Text Fragment 抽取指定开始位置 长度的片段

开始位置0起 = Slider(3, range=0..100)
片段长度 = Slider(4, range=0..100)
# Text Fragment 抽取指定开始位置 长度的片段
panel = Panel("0123456789")
fragment = TextFragment(Text=panel, Start=开始位置0起, Count=片段长度)
panel_2 = Panel(fragment)
