# Grasshopper definition Text Join.gh (Grasshopper 1.0.7)
# Text Join 我愿称之为合并加强版
# Join端可以设置组合分隔符号

# Text Join 我愿称之为合并加强版
# Join端可以设置组合分隔符号
panel = Panel("""1
7
3
A
5
6
7""")
join = TextJoin(Text=panel, Join="-")
panel_2 = Panel(join)
