# Grasshopper definition Text Trim.gh (Grasshopper 1.0.7)
# Text Trim 奇怪的功能，虽然名字带修剪，
# 但是只能删除空格，放大图标仔细看能看到空格键。。。

# Text Trim 奇怪的功能，虽然名字带修剪，
# 但是只能删除空格，放大图标仔细看能看到空格键。。。
虽然看不到_但是确实有空格23333 = Panel("      123      ")
尾空格true删除 = BooleanToggle(True)
首空格true删除 = BooleanToggle(False)
trim = TextTrim(Text=虽然看不到_但是确实有空格23333, Start=首空格true删除, End=尾空格true删除)
panel = Panel(trim)
