# Grasshopper definition 曲面法向案例.gh (Grasshopper 1.0.7)

subd = SubD(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)
panel = Panel("某博物馆简化版本")
brep = Brep(subd)
debrep = DeconstructBrep(Brep=brep)  # -> Faces, Edges, Vertices
number_slider = Slider(20, range=0..100)
cull_i = CullIndex(List=debrep.Faces, Indices=Slider(10, range=0..10), Wrap=True)
sdivide = DivideSurface(Surface=cull_i, UCount=number_slider, VCount=number_slider)  # -> flatten(Points), flatten(Normals), Parameters
line = LineSDL(Start=sdivide.Points, Direction=sdivide.Normals, Length=Slider(3, range=0..100))
preview = CustomPreview(Geometry=brep, Material=ColourSwatch(SwatchColor=RGBA(255, 255, 255, 89)))
preview_2 = CustomPreview(Geometry=line, Material=ColourSwatch(SwatchColor=RGB(175, 206, 255)))
