# Grasshopper definition 两个曲面局部相连成体.gh (Grasshopper 1.0.7)
# 提取两个曲面的一部分，通过两面四点相连成体

# ----
# 两个曲面分别位于不同位置
srf = Surface(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)
srf_2 = Surface(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)

# ----
# 将曲面的UV等分为x个小二维区间
number_slider = Slider(3, range=0..10)
divide = DivideDomain²(Domain=srf_2, UCount=number_slider, VCount=number_slider)

# ----
# 取出其中第y个小二维区间
number_slider_2 = Slider(4, range=0..10)
item = ListItem(List=divide, Index=number_slider_2, Wrap=True)

# ----
# 通过提取出的两个面的角点直线相连成体
blendbox = BlendBox(SurfaceA=srf_2, DomainA=item, SurfaceB=srf, DomainB=item)
tbox = TwistedBox(blendbox)
