# Grasshopper definition 沿曲线流动.gh (Grasshopper 1.0.7)
# 参考线变为目标线，物体跟随发生形变，原有属性（例如角度）保留

是否反转参考线 = BooleanToggle(True)
是否反转目标线 = BooleanToggle(False)
是否延展 = BooleanToggle(False)
是否刚体 = BooleanToggle(False)

# ----
# 基础物体
brep = Brep(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)

# ----
# 基础物体的参考线
crv = Curve(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)

# ----
# 目标线
crv_2 = Curve(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)

# ----
# 参考线变为目标线，物体跟随发生形变，原有属性（例如角度）保留
flow = Flow(Geometry=brep, Base=crv, Target=crv_2, ReverseBase=是否反转参考线, ReverseTarget=是否反转目标线, Stretch=是否延展, Rigid=是否刚体)
