# Grasshopper definition 对物体进行绕转.gh (Grasshopper 1.0.7)
# 对物体进行绕转

# ----
# 弧度
panel = Panel("0,5")
pi = Pi(Factor=panel)

第一半径 = Slider(1, range=0..1)
第二半径 = Slider(8, range=0..10)

# ----
# 中心平面
xy = XYPlane(Origin=Point(0, 0, 0))

是否变形 = BooleanToggle(False)

# ----
# 基础物体
brep = Brep(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)

# ----
# 对物体进行绕转
maelstrom = Maelstrom(Geometry=brep, Plane=xy, First=第一半径, Second=第二半径, Angle=pi, Rigid=是否变形)
