# Grasshopper definition 曲面流动(简化版).gh (Grasshopper 1.0.7)
# 将曲线从参考曲面流动到目标曲面

# ----
# 参考曲面1
# 参考曲面2
srf = Surface(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)
srf_2 = Surface(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)

pop2d = Populate2D(Region=srf_2, Count=100, Seed=1)

# ----
# 目标曲面
srf_3 = Surface(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)

cir = Circle(Plane=pop2d, Radius=Slider(0.3, range=0..1))

# ----
# 参考曲线
crv = Curve(cir)

# ----
# 将曲线从参考曲面流动到目标曲面
map_srf = MapToSurface(Curve=crv, Source=srf_2, Target=srf_3)
