# Grasshopper definition 让物体随自由曲线镜像.gh (Grasshopper 1.0.7)
# 让物体随自由曲线镜像

镜像后的物体能否超出曲线端头 = BooleanToggle(True)

# ----
# 需要镜像的物体
box = CenterBox(Base=PlaneXY(0, 0, 0), X=1, Y=4, Z=1)

# ----
# 对称曲线
crv = Curve(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)

# ----
# 让物体随自由曲线镜像
mirror = MirrorCurve(Geometry=box, Curve=crv, Tangent=镜像后的物体能否超出曲线端头)
