# Grasshopper definition 让物体根据曲面进行镜像.gh (Grasshopper 1.0.7)
# 让物体根据曲面进行镜像（随曲面发生形变）

是否可以超出曲面末端 = BooleanToggle(False)

# ----
# 需要镜像的物体
box = CenterBox(Base=PlaneXY(0, 0, 0), X=1, Y=2, Z=1)

# ----
# 对称曲面
srf = Surface(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)

# ----
# 让物体根据曲面进行镜像（随曲面发生形变）
mirror = MirrorSurface(Geometry=box, Surface=srf, Frame=是否可以超出曲面末端)
