# Grasshopper definition 通过移物体控制点来改变物件形状.gh (Grasshopper 1.0.7)
# 通过移物体控制点来改变物件形状

# ----
# 基础曲面
geo = Geometry(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)

# ----
# 提取曲面控制点
srfpt = SurfacePoints(Surface=geo)  # -> Points, Weights, Greville, UCount, VCount

# ----
# 随机起伏
lng = ListLength(List=srfpt.Points)
random = Random(Range=Domain(0, 5), Number=lng, Seed=2)  # -> flatten(Random)
Z = UnitZ(Factor=1)
amp = Amplitude(Vector=Z, Amplitude=random)

# ----
# 根据对控制点进行操作改变曲面
pdeform = PointDeform(Geometry=geo, Points=srfpt.Points, Motion=amp)
