# Grasshopper definition 根据点和矢量进行操作改变曲面(尖锐).gh (Grasshopper 1.0.7)
# 根据点和矢量进行操作改变曲面(可以非控制点）

# ----
# 基础曲面
geo = Geometry(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)

# ----
# 随机点
popgeo = PopulateGeometry(Geometry=geo, Count=20, Seed=1)

# ----
# 随机起伏
lng = ListLength(List=popgeo)
random = Random(Range=Domain(0, 3), Number=lng, Seed=2)  # -> flatten(Random)
Z = UnitZ(Factor=1)
amp = Amplitude(Vector=Z, Amplitude=random)

# ----
# 根据点和矢量进行操作改变曲面(可以非控制点）
deform = SpatialDeform(Geometry=geo, Syntax=popgeo, Forces=amp)
