# Grasshopper definition 定位物体至曲面并随曲面变形.gh (Grasshopper 1.0.7)
# 定位物体至曲面并随曲面变形

# ----
# 基础物体
box = CenterBox(Base=PlaneXY(0, 0, 0), X=1, Y=1, Z=1)

曲面定位uv坐标 = Panel("0.5,0.5")
旋转角度 = Slider(30, range=0..100)

# ----
# 定位曲面
srf = Surface(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)

# ----
# 基础物体的参考点
area = Area(Geometry=box)  # -> Area, Centroid

# ----
# 定位物体至曲面并随曲面变形
splop = Splop(
    Geometry=box,
    Plane=area.Centroid,
    Surface=reparameterize(srf),
    Parameter=曲面定位uv坐标,
    Angle=degrees(旋转角度),
    Rigid=Toggle(False))
