# Grasshopper definition 曲面流动(定位).gh (Grasshopper 1.0.7)
# 将基础面上的物件流动到目标曲面上-跟曲面UV相关联

# ----
# 参考曲面1
# 参考曲面2
srf = Surface(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)
srf_2 = Surface(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)

pop2d = Populate2D(Region=srf_2, Count=20, Seed=1)

# ----
# 基础曲面
srf_3 = Surface(srf_2)

目标面定位参考点 = Panel("0,0")
参考面定位参考点 = Panel("0,0")
会不会变形 = BooleanToggle(False)

# ----
# 目标曲面
srf_4 = Surface(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)

sph = Sphere(Base=pop2d, Radius=Slider(0.3, range=0..1))

# ----
# 将基础面上的物件流动到目标曲面上
sporph = Sporph(G=sph, S0=reparameterize(srf_3), P0=参考面定位参考点, S1=reparameterize(srf_4), P1=目标面定位参考点, R=会不会变形)
