# Grasshopper definition 单轴缩放指定区域的物体.gh (Grasshopper 1.0.7)
# 维持物体一部分不变，只单轴缩放指定区域的物体

延展长度 = Slider(4, range=0..10)
line = Line(Line((-0.8422209576, -1.772685085, 0), (1.073077482, -1.772685085, 0)))
是否刚体 = BooleanToggle(False)

# ----
# 基础物体
brep = Brep([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])

# ----
# 单轴缩放指定区域的物体
stretch = Stretch(Geometry=brep, Axis=line, Length=延展长度, Rigid=是否刚体)
