# Grasshopper definition 局部曲面生成TwistBox&物体跟随TwistBox扭曲.gh (Grasshopper 1.0.7)
# SurfaceBox曲面局部生成Twist Box-BoxMorph将物体跟随TwistBox的趋势扭曲

# ----
# 单元体
brep = Brep(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)

# ----
# 基础曲面
srf = Surface(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)

# ----
# 将曲面的UV等分为x个小二维区间
number_slider = Slider(3, range=0..10)
divide = DivideDomain²(Domain=srf, UCount=number_slider, VCount=number_slider)

# ----
# 单元体的外包围正方体
bbox = BoundingBox(Content=brep, Plane=PlaneXY(0, 0, 0), UnionBox=True)  # -> Box, Box_2

# ----
# 将划分出的曲面的角点-沿基础曲面上该点位置的法线方向移动距离height-并直线连接各点生成体
number_slider_2 = Slider(2, range=0..10)
sbox = SurfaceBox(Surface=srf, Domain=divide, Height=number_slider_2)

# ----
# 将BoundingBox扭曲为下方的Twisted Box-同时将物体赋予相同的变化
morph = BoxMorph(Geometry=brep, Reference=bbox.Box, Target=sbox)
