# Grasshopper definition 曲面流动(区间).gh (Grasshopper 1.0.7)
# 将基础面上的物件流动到目标曲面上-跟曲面UV相关联

# ----
# 参考曲面1
# 参考曲面2
srf = Surface(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)
srf_2 = Surface(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)

number_slider = Slider(3, range=0..10)

# ----
# 流动UV区间
number_slider_2 = Slider(0, range=0..100)
dom = ConstructDomain(DomainStart=number_slider_2, DomainEnd=Slider(0.5, range=0..1))

pop2d = Populate2D(Region=srf_2, Count=20, Seed=1)

# ----
# 基础曲面
geo = Geometry(srf_2)

Z = UnitZ(Factor=1)

# ----
# 参考box
extr = Extrude(Base=geo, Direction=Z)

# ----
# 目标曲面
srf_3 = Surface(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)

sph = Sphere(Base=pop2d, Radius=0.2)

# ----
# 将基础面上的物件流动到目标曲面上
srfmorph = SurfaceMorph(Geometry=sph, Reference=extr, Surface=reparameterize(srf_3), UDomain=dom, VDomain=dom, WDomain=dom)
