# Grasshopper definition 对物体进行锥状化变形.gh (Grasshopper 1.0.7)
# 对物体进行锥状化变形

起点半径 = Slider(3.5, range=0..10)
结束半径 = Slider(1.5, range=0..10)

# ----
# 基础物体
box = CenterBox(Base=PlaneXY(0, 0, 0), X=1, Y=1, Z=1)

# ----
# 参考轴
line = LineSDL(Start=Point(0, 0, 0), Direction=Vector(0, 0, 1), Length=2)

是否无限延展 = BooleanToggle(False)
是否单轴变形 = BooleanToggle(False)
是否刚体 = BooleanToggle(False)

# ----
# 锥状化变形
taper = Taper(Geometry=box, Axis=line, Start=起点半径, End=结束半径, Flat=是否单轴变形, Infinite=是否无限延展, Rigid=是否刚体)
