# Grasshopper definition 根据参考轴扭转物体.gh (Grasshopper 1.0.7)
# 根据参考轴扭转物体

# ----
# 基础物体
box = CenterBox(Base=PlaneXY(0, 0, 0), X=1, Y=1, Z=2)

# ----
# 参考轴
line = LineSDL(Start=Point(0, 0, -1), Direction=Vector(0, 0, 1), Length=2)

是否无限延展 = BooleanToggle(False)
pi = Pi(Factor=1)
是否刚体 = BooleanToggle(False)

# ----
# 根据参考轴扭转物体
twist = Twist(Geometry=box, Axis=line, Angle=pi, Infinite=是否无限延展, Rigid=是否刚体)
