# Grasshopper definition 八点生TwistBox.gh (Grasshopper 1.0.7)
# 根据八个点生成TwistBox

# ----
# 根据八个点生成扭转box
pt = Point(Point(2.752934285, -1.407683199, 4.340477549))
pt_2 = Point(Point(-0.9681331274, 2.531889356, 4.340477549))
pt_3 = Point(Point(5.36119319, 1.055910777, 4.340477549))
pt_4 = Point(Point(1.640125778, 4.995483332, 4.340477549))
pt_5 = Point(Point(-0.5130167299, 3.587800133, 0))
pt_6 = Point(Point(4.906076792, 3.587800133, 0))
pt_7 = Point(Point(-0.5130167299, 0, 0))
pt_8 = Point(Point(4.906076792, 0, 0))
tbox = TwistedBox(CornerA=pt, CornerB=pt_3, CornerC=pt_4, CornerD=pt_2, CornerE=pt_8, CornerF=pt_6, CornerG=pt_5, CornerH=pt_7)
