# Grasshopper definition 多段线线段方向排序.gh (Grasshopper 1.0.7)
# 多段线的线段根据同一个旋转方向排序

crv = Curve([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])

# ---- group: 寻找每根曲线的指导排序曲线
disc = Discontinuity(Curve=crv, Level=1)  # -> Points, Parameters
avr = Average(Input=disc.Points)
cir = Circle(Plane=avr, Radius=1)

# ----
explode = Explode(Curve=crv, Recursive=True)  # -> Segments, Vertices
midpt = CurveMiddle(Curve=explode.Segments)

# ---- group: 根据曲线对点排序
alongcrv = SortAlongCurve(Points=midpt, Curve=cir)  # -> Points, Indices
item = ListItem(List=explode.Segments, Index=alongcrv.Indices, Wrap=True)

# ---- group: 显示
midpt_2 = CurveMiddle(Curve=explode.Segments)
points = PointList(Points=midpt_2)
midpt_3 = CurveMiddle(Curve=item)
points_2 = PointList(Points=midpt_3)
